# Grasshopper definition 00_geo.ghx (Grasshopper 1.0.8)

# Design
number_slider = Slider(0.1, range=0..1)
line = Line([Line((1.614691864, 1.746989442, -0.7182930352), (2.525141228, 1.319440254, -0.7182930352)), Line((1.614691864, 1.746989442, -0.7182930352), (2.525141228, 1.746989442, -0.7182930352)), Line((2.525141228, 1.746989442, -0.7182930352), (3.236425144, 1.746989442, -0.7182930352)), Line((2.525141228, 1.746989442, -0.7182930352), (2.525141228, 1.319440254, -0.7182930352)), Line((3.236425144, 0.9854196329, -0.7182930352), (3.236425144, 1.746989442, -0.7182930352)), Line((3.236425144, 0.9854196329, -0.7182930352), (2.525141228, 1.319440254, -0.7182930352))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])
widths = Number([0.05, 0.05, 0.05, 0.05, 0.05, 0.05, 0.05, 0.05, 0.05, 0.05, 0.05, 0.05, 0.05, 0.05])
point = Point([Point(1.614691864, 1.746989442, -0.7182930352), Point(2.525141228, 1.746989442, -0.7182930352), Point(2.525141228, 1.319440254, -0.7182930352), Point(3.236425144, 1.746989442, -0.7182930352), Point(3.236425144, 0.9854196329, -0.7182930352), Point(3.881981114, 1.746989442, -0.7182930352), Point(3.612068176, 1.428570042, -0.7182930352)])
point_list = PointList(Points=point, Size=number_slider)
heights = Number([0.06, 0.06, 0.06, 0.06, 0.06, 0.06, 0.06, 0.06, 0.06, 0.06, 0.06, 0.06, 0.06, 0.06])
# Convert to Truss
python_3_script = Python3Script(points=point, lines=line, widths=widths, heights=heights)  # -> out, cut_rectangles, rectangles, truss, beams, beam_ids, points, nodes; inputs points: list of Point3d, lines: list of Line, widths: list of Double, heights: list of Double
# ---------- python_3_script: Python ----------
import os
import sys
import importlib
HERE = ghdoc.Path
path =  os.path.abspath(os.path.join(HERE, '..', '..', 'python'))

if path not in sys.path:
    sys.path.append(path)

if "geometry" in sys.modules:
    importlib.reload(sys.modules["geometry"])

from geometry import Truss, Beam, Node

#make truss
truss = Truss()

for p in points:
    truss.add_node(p)

for l,h,w in zip(lines, heights, widths):
    truss.add_beam(l,h,w)

beams = truss.beams
nodes = truss.nodes

beam_ids = [b.id for b in truss.beams]
points = [b.centroid for b in truss.beams]

#get cut geometry

truss.cut_all_beams()

cut_rectangles = [b.cut_polyline for b in truss.beams]
rectangles = [b.uncut_polyline for b in truss.beams]
# ---------- end python_3_script ----------
# Export
python_3_script_2 = Python3Script(truss=python_3_script.truss, export=Toggle(True), file_name="truss")  # -> out, cut_rectangles, rectangles, truss; inputs file_name: String
# ---------- python_3_script_2: Python ----------
import os
import sys
import importlib
HERE = ghdoc.Path
path =  os.path.abspath(os.path.join(HERE, '..', '..', 'python'))

if path not in sys.path:
    sys.path.append(path)

if "geometry" in sys.modules:
    importlib.reload(sys.modules["geometry"])

JSON = os.path.abspath(os.path.join(HERE, '..', '..', 'json'))
file_path = JSON + "/" + file_name + ".json"

if path not in sys.path:
    sys.path.append(path)

if export:
    truss.to_json(file_path)
# ---------- end python_3_script_2 ----------
geometry = Geometry(python_3_script.cut_rectangles)
curve = Curve(python_3_script.rectangles)
# place 0,1 and change width of 2
python_3_script_3 = Python3Script(truss=python_3_script_2.truss, export=Toggle(True), file_name="truss_01")  # -> out, cut_rectangles, rectangles, truss; inputs file_name: String
# ---------- python_3_script_3: Python ----------
import os
import sys
import importlib
HERE = ghdoc.Path
path =  os.path.abspath(os.path.join(HERE, '..', '..', 'python'))

if path not in sys.path:
    sys.path.append(path)

if "geometry" in sys.modules:
    importlib.reload(sys.modules["geometry"])

JSON = os.path.abspath(os.path.join(HERE, '..', '..', 'json'))
file_path = JSON + "/" + file_name + ".json"

print(truss.beams[2].width)

#beams 0, 1 have been placed
truss.beams[0].fabricated = True
truss.beams[1].fabricated = True
truss.beams[3].width = 0.09


if export:
    truss.to_json(file_path)
# ---------- end python_3_script_3 ----------
# Import
python_3_script_4 = Python3Script(read=Toggle(True), file_name="truss_01")  # -> out, truss, nodes, beams, cut_rectangles, helper; inputs read: Boolean, file_name: String
# ---------- python_3_script_4: Python ----------
import os
import sys
import importlib
HERE = ghdoc.Path
path =  os.path.abspath(os.path.join(HERE, '..', '..', 'python'))

if path not in sys.path:
    sys.path.append(path)

if "geometry" in sys.modules:
    importlib.reload(sys.modules["geometry"])

JSON = os.path.abspath(os.path.join(HERE, '..', '..', 'json'))
file_path = JSON + "/" + file_name + ".json"

from geometry import Truss

if read:
    truss = Truss.from_json(file_path)
    nodes = truss.nodes
    beams = truss.beams
    for beam in beams:
        print(beam.width, beam.reference_width)
    
    truss.cut_all_beams()
    cut_rectangles = [b.cut_polyline for b in truss.beams]

    helper = []
    for n in nodes:
        helper.append(n.helper)
# ---------- end python_3_script_4 ----------
custom_preview = CustomPreview(Geometry=geometry, Material=ColourSwatch(SwatchColor=RGB(255, 0, 0)))
curve_2 = Curve(python_3_script_4.cut_rectangles)
panel = Panel(python_3_script.out)
line_2 = Line([Line((2.525141228, 1.746989442, -0.7182930352), (2.780884229, 1.473166087, -0.7182930352)), Line((2.525141228, 1.319440254, -0.7182930352), (2.780884229, 1.473166087, -0.7182930352)), Line((2.780884229, 1.473166087, -0.7182930352), (3.236425144, 0.9854196329, -0.7182930352)), Line((3.236425144, 1.746989442, -0.7182930352), (2.780884229, 1.473166087, -0.7182930352))])
text_tag = TextTag(Location=python_3_script.points, Text=python_3_script.beam_ids, Colour=ColourSwatch(SwatchColor=RGB(255, 255, 255)))
point_2 = Point(Point(2.780884229, 1.473166087, -0.7182930352))
custom_preview_2 = CustomPreview(Geometry=python_3_script_4.cut_rectangles, Material=ColourSwatch(SwatchColor=RGB(0, 255, 85)))
mesh = Mesh(python_3_script_4.cut_rectangles)
python_script = PythonScript(x=python_3_script_4.helper)  # -> out, a
# ---------- python_script: Python ----------
a=x
# ---------- end python_script ----------
python_3_script_5 = Python3Script(truss=python_3_script_4.truss, export=Toggle(True), file_name="truss_02", new_node=point_2, new_axis=line_2)  # -> out, cut_rectangles, rectangles, truss, nodes; inputs file_name: String, new_node: Point3d, new_axis: list of Line
# ---------- python_3_script_5: Python ----------
import os
import sys
import importlib
HERE = ghdoc.Path
path =  os.path.abspath(os.path.join(HERE, '..', '..', 'python'))

if path not in sys.path:
    sys.path.append(path)

if "geometry" in sys.modules:
    importlib.reload(sys.modules["geometry"])

JSON = os.path.abspath(os.path.join(HERE, '..', '..', 'json'))
file_path = JSON + "/" + file_name + ".json"

print(truss.beams[2].width)
print(len(truss.nodes))

#beams 0, 1 have been placed
truss.beams[3].fabricated = True
truss.add_node(new_node)
nodes = truss.nodes
for axis in new_axis:
    truss.add_beam(axis, 0.05, 0.06, True, False)


if export:
    truss.to_json(file_path)
# ---------- end python_3_script_5 ----------
geometry_2 = Geometry(geometry)
explode = Explode(Curve=geometry_2, Recursive=True)  # -> Segments, Vertices
panel_2 = Panel(python_script.a)
geometry_3 = Geometry(python_script.a)
python_3_script_6 = Python3Script(read=Toggle(True), file_name="truss_02")  # -> out, truss, nodes, beams, cut_rectangles, beam_ids, points, helper; inputs read: Boolean, file_name: String
# ---------- python_3_script_6: Python ----------
import os
import sys
import importlib
HERE = ghdoc.Path
path =  os.path.abspath(os.path.join(HERE, '..', '..', 'python'))

if path not in sys.path:
    sys.path.append(path)

if "geometry" in sys.modules:
    importlib.reload(sys.modules["geometry"])

JSON = os.path.abspath(os.path.join(HERE, '..', '..', 'json'))
file_path = JSON + "/" + file_name + ".json"

from geometry import Truss

if read:
    truss = Truss.from_json(file_path)
    nodes = truss.nodes
    beams = truss.beams
    for beam in beams:
        print(beam.width, beam.reference_width)

    beam_ids = [b.id for b in truss.beams]
    points = [b.centroid for b in truss.beams]

    truss.cut_all_beams()
    cut_rectangles = [b.cut_polyline for b in truss.beams]

    helper = []
    for n in nodes:
        helper.append(n.helper)
# ---------- end python_3_script_6 ----------
python_script_2 = PythonScript(x=python_3_script_6.helper)  # -> out, a; same code as python_script
panel_3 = Panel(python_3_script.beams)
panel_4 = Panel(explode.Vertices)
point_3 = Point(python_script_2.a)
panel_5 = Panel(geometry_3)
panel_6 = Panel(python_3_script.nodes)
text_tag_2 = TextTag(Location=python_3_script_6.points, Text=python_3_script_6.beam_ids, Colour=ColourSwatch(SwatchColor=RGB(255, 255, 255)))
panel_7 = Panel(python_3_script_4.out)
panel_8 = Panel(python_3_script_6.out)
panel_9 = Panel(python_3_script_6.nodes)
panel_10 = Panel(python_3_script_6.beams)
custom_preview_3 = CustomPreview(Geometry=python_3_script_6.cut_rectangles, Material=ColourSwatch(SwatchColor=RGB(255, 0, 0)))
