# Grasshopper definition 240506_planning_test.ghx (Grasshopper 1.0.7)
# plug-ins: Bifocals, NGon, Weaverbird, Kangaroo2 Components

info = Info()  # -> info
#   port info: Environment info.
# ---------- info: Python ----------
"""
Displays information about the active COMPAS environment.
"""
import compas_bootstrapper
from ghpythonlib.componentbase import executingcomponent as component

import compas
import compas_fab


class CompasInfo(component):
    def RunScript(self):
        self.Message = 'COMPAS v{}'.format(compas.__version__)
        info = 'COMPAS Version: {}\nEnvironment: {}\nCOMPAS FAB Version:{}'
        return (info.format(compas.__version__, compas_bootstrapper.ENVIRONMENT_NAME,compas_fab.__version__))
# ---------- end info ----------

# ----
# Load Robot
connect = BooleanToggle(True)
ros_connect = ROSConnect(connect=connect)  # -> ros_client, is_connected; inputs port: Int32, connect: Boolean
#   port ip: The ip address ROS. Defaults to 127.0.0.1.
#   port port: The port of ROS. Defaults to 9090.
#   port connect: If True, connects to ROS. If False, disconnects from ROS. Defaults to False.
#   port ros_client: The ROS client.
#   port is_connected: True if connection established.
# ---------- ros_connect: Python ----------
"""
Connect or disconnect to ROS.

COMPAS FAB v0.27.0
"""
from ghpythonlib.componentbase import executingcomponent as component
from scriptcontext import sticky as st

from compas_fab.backends import RosClient
from compas_fab.ghpython.components import create_id


class ROSConnect(component):
    def RunScript(self, ip, port, connect):
        ros_client = None

        ip = ip or '127.0.0.1'
        port = port or 9090

        key = create_id(self, 'ros_client')
        ros_client = st.get(key, None)

        if ros_client:
            st[key].close()
        if connect:
            st[key] = RosClient(ip, port)
            st[key].run(5)

        ros_client = st.get(key, None)
        is_connected = ros_client.is_connected if ros_client else False
        return (ros_client, is_connected)
# ---------- end ros_connect ----------
load_robot = BooleanToggle(True)
ros_robot = ROSRobot(ros_client=ros_connect.ros_client, load=load_robot)  # -> robot; inputs load: Boolean
#   port ros_client: The ROS client.
#   port load: If True, loads the robot from ROS. Defaults to False.
# ---------- ros_robot: Python ----------
"""
Load robot directly from ROS.

COMPAS FAB v0.27.0
"""
from compas_ghpython.artists import RobotModelArtist
from ghpythonlib.componentbase import executingcomponent as component
from scriptcontext import sticky as st

from compas_fab.ghpython.components import create_id


class ROSRobot(component):
    def RunScript(self, ros_client, load):
        key = create_id(self, 'robot')

        if ros_client and ros_client.is_connected and load:
            # Load URDF from ROS
            st[key] = ros_client.load_robot(load_geometry=True, precision='12f')
            st[key].artist = RobotModelArtist(st[key].model)

        robot = st.get(key, None)
        if robot:  # client sometimes need to be restarted, without needing to reload geometry
            robot.client = ros_client
        return robot
# ---------- end ros_robot ----------

# ---- group: set config
# Configuration A
# Robot Display
# (No collision checking)
a1 = Slider(0, range=-360..360)
a2 = Slider(0, range=-360..360)
a4 = Slider(0, range=-360..360)
a5 = Slider(0, range=-360..360)
a3 = Slider(0, range=-360..360)
a6 = Slider(0, range=-360..360)
config = PythonScript(vals=[a1, a2, a3, a4, a5, a6])  # -> config; inputs vals: list
# ---------- config: Python ----------
import math
from compas.robots import Configuration

config = Configuration.from_revolute_values([math.radians(a) for a in vals])
print config
# ---------- end config ----------

# ----
a1_2 = Slider(90, range=-360..360)
a2_2 = Slider(0, range=-360..360)
a4_2 = Slider(0, range=-360..360)
a5_2 = Slider(0, range=-360..360)
a3_2 = Slider(0, range=-360..360)
a6_2 = Slider(0, range=-360..360)
# Dual Gofa Playground - 01272023
# Author: Jingwen Wang
# Email: jingwen.wang@epfl.ch
# Based on:
# ABB Gofa Playground by Maxence
your_version = Panel(info)

panel = Panel("""0.00041166767187156717
0.005882192447675842
-3.129394251246824""")
panel_2 = Panel("""3.070587026068542
0.019064029578026894
0.015637209791168258""")
ghpython_script = GhPythonScript(xyz=simplify(flatten(panel_2)), rpy=simplify(flatten(panel)))  # -> out, T, T_R, T_inv, T_Rinv; inputs xyz: list, rpy: list
# ---------- ghpython_script: Python ----------
from compas.geometry import Translation, Rotation, Vector
from compas_rhino.conversions import xform_to_rhino 
T= Translation.from_vector(Vector(*xyz)) * Rotation.from_euler_angles(rpy,static = True, axes = "xyz")
T_R = xform_to_rhino(T)
T_inv = T.inverse()
T_Rinv = xform_to_rhino(T_inv)
# ---------- end ghpython_script ----------
transformrobotatorobotb = Transform(ghpython_script.T_R)

config_2 = PythonScript(vals=[a1_2, a2_2, a3_2, a4_2, a5_2, a6_2])  # -> config; inputs vals: list; same code as config
# Package Version: COMPAS Version: 1.17.4
# COMPAS FAB Version:0.27.0
number_slider = Slider(0.15, range=0..1)
pt = ConstructPoint(XCoordinate=0, YCoordinate=0, ZCoordinate=number_slider)
pt_2 = ConstructPoint(XCoordinate=0, YCoordinate=0, ZCoordinate=number_slider)
xy_plane = XYPlane(Origin=pt_2)

# ----
# Table
# Tool Attachment
swatch = ColourSwatch(SwatchColor=RGB(255, 254, 254))
brep = Brep([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])
material = CreateMaterial(Diffuse=swatch, Specular=RGB(255, 254, 254), Emission=RGB(0, 0, 0), Transparency=0, Shine=0)
preview = CustomPreview(Geometry=brep, Material=material)

rad = Radians(Degrees=Slider(45, range=0..100))
xy_plane_2 = XYPlane(Origin=pt)
surface = Surface([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])
surface_2 = Surface([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])
rad_2 = Radians(Degrees=Slider(45, range=0..100))

# ----
# robotA PICKUP Approach Config
pt_3 = Point(Point(0.9160342103, 0.2147832089, 0.8513199443))
xy = XYPlane(Origin=pt_3)

prot = RotatePlane(Plane=xy_plane, Angle=rad)
robot_visualize = RobotVisualize(
    robot=ros_robot,
    group_A="robotA",
    group_B="robotB",
    configuration_A=config,
    configuration_B=config_2,
    show_frames=True,
    show_acm=True)  # -> visual, collision, attached_meshes, frames, base_frame, ee_frame; inputs attached_collision_meshes: list, show_visual: Boolean, show_collision: Boolean, show_frames: Boolean, show_base_frame: Boolean, show_end_effector_frame: Boolean, show_acm: Boolean
#   port group_A: The planning group used for end-effector and base visualization.
#   port configuration_A: The robot's full configuration.
#   port attached_collision_meshes: A list of attached collision meshes.
#   port show_visual: Whether or not to show the robot's visual meshes.
#   port show_collision: Whether or not to show the robot's collision meshes.
#   port show_frames: Whether or not to show the robot's joint frames.
#   port show_base_frame: Whether or not to show the robot's base frame.
#   port show_end_effector_frame: Whether or not to show the robot's end-effector frame.
#   port show_acm: Whether or not to show the attached collision meshes (if any).
#   port visual: The robot's visual Rhino meshes (if any).
#   port collision: The robot's collision Rhino meshes (if any).
#   port attached_meshes: The attached collision Rhino meshes (if any).
#   port frames: The robot's joint frames as Rhino planes (if any).
#   port base_frame: The robot's base frame as a Rhino plane (if any).
#   port ee_frame: The robot's end-effector frame as a Rhino plane (if any).
# ---------- robot_visualize: Python ----------
"""
Visualizes the robot.

COMPAS FAB v0.22.0
"""
from compas.geometry import Frame
from compas.geometry import Transformation
from compas_ghpython.artists import FrameArtist
from compas_ghpython.artists import MeshArtist
from ghpythonlib.componentbase import executingcomponent as component


class RobotVisualize(component):
    def RunScript(self, robot, group_A, group_B, configuration_A, configuration_B, attached_collision_meshes, show_visual, show_collision,
                  show_frames, show_base_frame, show_end_effector_frame, show_acm):

        visual = None
        collision = None
        attached_meshes = None
        frames = None
        base_frame = None
        ee_frame = None

        if robot:
            show_visual = True if show_visual is None else show_visual
            configuration_A = configuration_A or robot.zero_configuration()
            configuration_B = configuration_B or robot.zero_configuration()
            zero = robot.zero_configuration()
            a = robot.merge_group_with_full_configuration(configuration_A, zero, group = group_A)
            b = robot.merge_group_with_full_configuration(configuration_B, a, group = group_B)
            
            robot.update(b, visual=show_visual, collision=show_collision)
            compas_frames = robot.transformed_frames(b)

            if show_visual:
                visual = robot.artist.draw_visual()

            if show_collision:
                collision = robot.artist.draw_collision()

            if show_base_frame:
                base_compas_frame = compas_frames[0]
                artist = FrameArtist(base_compas_frame)
                base_frame = artist.draw()

            if show_end_effector_frame:
                ee_compas_frame = robot.forward_kinematics(configuration, group, options=dict(solver='model'))
                artist = FrameArtist(ee_compas_frame)
                ee_frame = artist.draw()

            if show_frames:
                frames = []
                for compas_frame in compas_frames[1:]:
                    artist = FrameArtist(compas_frame)
                    frame = artist.draw()
                    frames.append(frame)

            if show_acm:
                attached_meshes = []
                for acm in attached_collision_meshes:
                    frame = robot.forward_kinematics(configuration, options=dict(solver='model', link_name=acm.link_name))
                    T = Transformation.from_frame_to_frame(Frame.worldXY(), frame)
                    mesh = acm.collision_mesh.mesh.transformed(T)
                    attached_meshes.append(MeshArtist(mesh).draw())

        return (visual, collision, attached_meshes, frames, base_frame, ee_frame)
# ---------- end robot_visualize ----------
prot_2 = RotatePlane(Plane=xy_plane_2, Angle=rad_2)

refresh = Button()
planning_scene = GhPythonScript(robot=ros_robot, refresh=refresh)  # -> a
# ---------- planning_scene: Python ----------
from compas_fab.robots import PlanningScene

from compas.artists import Artist
from compas.geometry import Frame
from compas.geometry import Transformation


scene = PlanningScene(robot)

collision_meshes = []
attached_collision_meshes = []

configuration = robot.zero_configuration()
scene = robot.client.get_planning_scene()

for co in scene.world.collision_objects:
    header = co.header
    frame_id = header.frame_id
    cms = co.to_collision_meshes()

    for cm in cms:
        if cm.frame != Frame.worldXY():
            t = Transformation.from_frame(cm.frame)
            mesh = cm.mesh.transformed(t)
        else:
            mesh = cm.mesh

        collision_meshes.append(mesh)

    for aco in scene.robot_state.attached_collision_objects:
        for acm in aco.to_attached_collision_meshes():
            frame_id = aco.object["header"]["frame_id"]
            frame = robot.forward_kinematics(configuration, options=dict(link=frame_id))
            t = Transformation.from_frame(frame)

            # Local CM frame
            if (acm.collision_mesh.frame and acm.collision_mesh.frame != Frame.worldXY()):
                t = t * Transformation.from_frame(acm.collision_mesh.frame)

            mesh = acm.collision_mesh.mesh.transformed(t)

            attached_collision_meshes.append(mesh)

a = []
for cm in collision_meshes + attached_collision_meshes:
    a.append(Artist(cm).draw_mesh())
# ---------- end planning_scene ----------

radians = Radians(Degrees=Slider(180, range=0..360))
solid_union = SolidUnion(Breps=brep)
pflip = FlipPlane(Plane=xy, ReverseX=Toggle(False), ReverseY=Toggle(False), SwapAxes=Toggle(True))

# ----
# Tool
gripper_bounding_box_mesh = Mesh(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)
gripper_meshes = Mesh([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])
mjoin = MeshJoin(Meshes=gripper_meshes)
tool = AttachedTool(robot=ros_robot, visual_mesh=mjoin, collision_mesh=gripper_bounding_box_mesh, tcf_plane=prot, group="robotA")  # -> robot; inputs visual_mesh: Mesh, collision_mesh: Mesh
#   port visual_mesh: A visual mesh for the tool.
#   port collision_mesh: A collision mesh for the tool.
#   port tcf_plane: The frame of the tool in tool0 frame.
#   port group: The planning group to which the tool should be attached.
# ---------- tool: Python ----------
"""
Attach a tool to the robot.

COMPAS FAB v0.27.0
"""
from ghpythonlib.componentbase import executingcomponent as component
from compas_rhino.conversions import RhinoMesh
from compas_rhino.conversions import plane_to_compas_frame

from compas.geometry import Frame
from compas_fab.robots import Tool


class AttachToolComponent(component):
    def RunScript(self, robot, visual_mesh, collision_mesh, tcf_plane, group):
        if robot and robot.client and robot.client.is_connected and visual_mesh:
            if not collision_mesh:
                collision_mesh = visual_mesh

            c_visual_mesh = RhinoMesh.from_geometry(visual_mesh).to_compas()
            c_collision_mesh = RhinoMesh.from_geometry(collision_mesh).to_compas()

            if not tcf_plane:
                frame = Frame.worldXY()
            else:
                frame = plane_to_compas_frame(tcf_plane)
                print frame.quaternion
            tool = Tool(c_visual_mesh, frame, c_collision_mesh)

            robot.attach_tool(tool, group)

        return robot
# ---------- end tool ----------

custom_preview = CustomPreview(Geometry=surface_2, Material=ColourSwatch(SwatchColor=RGBA(149, 122, 230, 87)))
range = Range(Domain=Domain(0, 1), Steps=Slider(5, range=0..10))
range_2 = Range(Domain=Domain(0, 1), Steps=Slider(2, range=0..10))
range_3 = Range(Domain=Domain(0, 1), Steps=Slider(1, range=0..10))
rotate_plane = RotatePlane(Plane=pflip, Angle=radians)
ghpython_script_2 = GhPythonScript(surfaces=surface_2, tX=range, tY=range_2, tZ=range_3)  # -> out, polylines; inputs surfaces: list of Surface, tX: list, tY: list, tZ: list
# ---------- ghpython_script_2: Python ----------
import Rhino.Geometry as rg


for srf in surfaces:
    srf.SetDomain(0,rg.Interval(0,1))
    srf.SetDomain(1,rg.Interval(0,1))

lines = []
points=[]

for y in tY:
    for x in tX:
        temp = []
        
        pointA = surfaces[0].PointAt(x,y)
        pointB = surfaces[1].PointAt(x,y)
        line = rg.Line(pointA, pointB)
        for i,z in enumerate(tZ):
            point = line.PointAt(z)
            temp.append(point)
        lines.append(line)
        points.append(temp)

polylines = []
for i in range( len(tX)+1, len(tX)*len(tY)):
    if i%len(tX)!=0:
        for z in range(1, len(tZ)):
            A = points[i][z-1]
            B = points[i-1][z-1]
            C = points[i-len(tX)-1][z-1]
            D = points[i-len(tX)][z-1]
            
            E = points[i][z]
            F = points[i-1][z]
            G = points[i-len(tX)-1][z]
            H = points[i-len(tX)][z]
            polylines.append([A,B,C,D,E,F,G,H])
# ---------- end ghpython_script_2 ----------
panel_3 = Panel("""Q{0;1;2;3}
Q{7;6;5;4}
Q{3;2;6;7}
Q{2;1;5;6}
Q{1;0;4;5}
Q{0;3;7;4}""")
ghpython_script_3 = GhPythonScript(x=ghpython_script_2.polylines)  # -> out, a
# ---------- ghpython_script_3: Python ----------
a=x
# ---------- end ghpython_script_3 ----------
construct_mesh = ConstructMesh(Vertices=ghpython_script_3.a, Faces=panel_3)
construct_point = ConstructPoint(XCoordinate=0, YCoordinate=expr("-x", Slider(2, range=0..10)), ZCoordinate=Slider(4, range=0..10))
number_slider_2 = Slider(0.025, range=0..0.1)
weaverbird_s_bevel_edges = WeaverbirdsBevelEdges(MeshPolylines=construct_mesh, Distance=Slider(25, range=0..100), InsetType=0)
diagonalize = Diagonalize(Mesh=construct_mesh)
point = Point(construct_point)
mesh_edges = MeshEdges(Mesh=construct_mesh)  # -> NakedEdges, InteriorEdges, NonManifoldEdges

pickup_plane__robota = Data(pflip)

sphere = Sphere(Base=point, Radius=1)
populate_geometry = PopulateGeometry(Geometry=sphere, Count=Slider(4, range=0..10), Seed=1)
dual = Dual(Mesh=construct_mesh, Type="0")
mesh_edges_2 = MeshEdges(Mesh=weaverbird_s_bevel_edges)  # -> NakedEdges, InteriorEdges, NonManifoldEdges
mesh_edges_3 = MeshEdges(Mesh=diagonalize)  # -> NakedEdges, InteriorEdges, NonManifoldEdges
mesh_edges_4 = MeshEdges(Mesh=dual)  # -> NakedEdges, InteriorEdges, NonManifoldEdges
multiplication = Multiplication(A=number_slider_2, B=Slider(2000, range=0..10000))
line = Line(StartPoint=point, EndPoint=populate_geometry)
length = Length(Curve=line)
panel_4 = Panel(multiplication)
pipe = Pipe(Curve=[mesh_edges.NakedEdges, mesh_edges.InteriorEdges, mesh_edges.NonManifoldEdges], Radius=number_slider_2, Caps=0)
pipe_2 = Pipe(
    Curve=[mesh_edges_2.InteriorEdges, mesh_edges_2.NakedEdges, mesh_edges_2.NonManifoldEdges],
    Radius=number_slider_2,
    Caps=0)
pipe_3 = Pipe(
    Curve=[mesh_edges_4.NakedEdges, mesh_edges_4.InteriorEdges, mesh_edges_4.NonManifoldEdges],
    Radius=number_slider_2,
    Caps=0)
pipe_4 = Pipe(
    Curve=[mesh_edges_3.NakedEdges, mesh_edges_3.InteriorEdges, mesh_edges_3.NonManifoldEdges],
    Radius=number_slider_2,
    Caps=0)
point_on_curve = PointOnCurve(line, parameter=0.5)
number_slider_3 = Slider(0.07, range=0..0.1)
list_length = ListLength(List=flatten(pipe))
list_length_2 = ListLength(List=flatten(pipe_4))
plane_normal = PlaneNormal(Origin=point_on_curve, ZAxis=line)
curve = Curve(flatten([mesh_edges.NakedEdges, mesh_edges.InteriorEdges, mesh_edges.NonManifoldEdges, mesh_edges_3.NakedEdges, mesh_edges_3.InteriorEdges, mesh_edges_3.NonManifoldEdges]))
removeduplicatelines = RemoveDuplicateLines(Lines=curve, Tolerance=0.01)
addition = Addition(A=list_length, B=list_length_2)
center_box = CenterBox(Base=plane_normal, X=number_slider_3, Y=number_slider_3, Z=expr("0.5*x", length))
custom_preview_2 = CustomPreview(Geometry=[pipe_4, pipe], Material=ColourSwatch(SwatchColor=RGB(140, 119, 89)))
panel_5 = Panel(addition)
list_item = ListItem(List=curve, Index="0", Wrap=True)
list_item_2 = ListItem(List=removeduplicatelines, Index=Slider(240, range=0..260), Wrap=True)
point_on_curve_2 = PointOnCurve(list_item, parameter=0.5)
point_2 = Point(point_on_curve_2)
point_on_curve_3 = PointOnCurve(list_item_2, parameter=0.5)
point_3 = Point(point_on_curve_3)

# ----
# Tool
gripper_bounding_box_mesh_2 = Mesh(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)
gripper_meshes_2 = Mesh([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])
mjoin_2 = MeshJoin(Meshes=gripper_meshes_2)

volume = Volume(Geometry=gripper_bounding_box_mesh_2)  # -> Volume, Centroid
scale = Scale(Geometry=gripper_bounding_box_mesh_2, Center=volume.Centroid, Factor=Slider(0.9, range=0..1))  # -> Geometry, Transform

tool_2 = AttachedTool(robot=tool, visual_mesh=mjoin_2, collision_mesh=scale.Geometry, tcf_plane=prot_2, group="robotB")  # -> robot; inputs visual_mesh: Mesh, collision_mesh: Mesh; same code as tool

robot = Data(tool_2)
merge_config = MergeConfig(robot=tool_2, config_a=config, config_b=config_2, group_A="robotA", group_B="robotB")  # -> config
#   port config_a: The configuration to use as base for the merge.
#   port config_b: The configuration used to merge into the base one.
#   port config: The merged configuration.
# ---------- merge_config: Python ----------
"""
Merge two configurations.

COMPAS FAB v0.24.0
"""
from ghpythonlib.componentbase import executingcomponent as component


class ConfigMerge(component):
    def RunScript(self, robot, config_a, config_b, group_A, group_B):

        if config_a and config_b:
            config_A = robot.zero_configuration(group = group_A)
            config_A.joint_values = config_a.joint_values
            config_B = robot.zero_configuration(group = group_B)
            config_B.joint_values = config_b.joint_values
            return config_A.merged(config_B)

        return None
# ---------- end merge_config ----------

# ----
# robotB PICKUP Approach Config
pt_4 = Point(Point(1.83568464, -0.6620598858, 0.1849115051))
xy_2 = XYPlane(Origin=pt_4)
pflip_2 = FlipPlane(Plane=xy_2, ReverseX=Toggle(False), ReverseY=Toggle(False), SwapAxes=Toggle(True))
vec = VectorXYZ(XComponent=0, YComponent=0, ZComponent=Slider(0.1, range=0..0.1))  # -> Vector, Length
move = Move(Geometry=pflip_2, Motion=vec.Vector)  # -> Geometry, Transform
inverse_kinematics = InverseKinematics(robot=robot, plane=move.Geometry, group="robotB")  # -> configuration
#   port plane: The plane or frame to calculate the inverse kinematic for.
#   port start_configuration: If passed, calculates the inverse such that the joint positions differ the least from the start_configuration. Defaults to the zero configuration.
#   port group: The planning group used for calculation. Defaults to the robot's main planning group.
#   port configuration: The planning group's configuration.
# ---------- inverse_kinematics: Python ----------
"""
Calculate the robot's inverse kinematic for a given plane.

COMPAS FAB v0.27.0
"""
from compas_rhino.conversions import RhinoPlane
from ghpythonlib.componentbase import executingcomponent as component


class InverseKinematics(component):
    def RunScript(self, robot, plane, start_configuration, group):
        configuration = None
        if robot and robot.client and robot.client.is_connected and plane:
            frame = RhinoPlane.from_geometry(plane).to_compas_frame()
            configuration = robot.inverse_kinematics(frame, start_configuration, group)
        return configuration
# ---------- end inverse_kinematics ----------

robot_visualize_2 = RobotVisualize(robot=ros_robot, configuration=merge_config)  # -> visual, collision, collision_meshes, attached_meshes, frames, base_frame, ee_frame; inputs show_visual: Boolean, show_collision: Boolean, show_frames: Boolean, show_base_frame: Boolean, show_end_effector_frame: Boolean, show_cm: Boolean, show_acm: Boolean; disabled
#   port group: The planning group used for end-effector and base visualization.
#   port configuration: The robot's full configuration.
#   port show_visual: Whether or not to show the robot's visual meshes.
#   port show_collision: Whether or not to show the robot's collision meshes.
#   port show_frames: Whether or not to show the robot's joint frames.
#   port show_base_frame: Whether or not to show the robot's base frame.
#   port show_end_effector_frame: Whether or not to show the robot's end-effector frame.
#   port show_cm: Whether or not to show the collision meshes (if any).
#   port show_acm: Whether or not to show the attached collision meshes (if any).
#   port visual: Rhino meshes of the robot's visual geometry (if any).
#   port collision: Rhino meshes of the robot's collision geometry (if any).
#   port collision_meshes: Rhino meshes of the scene's collision meshes (if any).
#   port attached_meshes: Rhino meshes of the scene's attached collision meshes (if any).
#   port frames: The robot's joint frames as Rhino planes (if any).
#   port base_frame: The robot's base frame as a Rhino plane (if any).
#   port ee_frame: The robot's end-effector frame as a Rhino plane (if any).
# ---------- robot_visualize_2: Python ----------
"""
Visualizes the robot.

COMPAS FAB v0.27.0
"""
from compas.artists import Artist
from compas.geometry import Frame
from compas.geometry import Transformation
from compas_fab.robots import PlanningScene
from ghpythonlib.componentbase import executingcomponent as component


class RobotVisualize(component):
    def RunScript(
        self,
        robot,
        group,
        configuration,
        show_visual,
        show_collision,
        show_frames,
        show_base_frame,
        show_end_effector_frame,
        show_cm,
        show_acm,
    ):

        visual = None
        collision = None
        collision_meshes = None
        attached_meshes = None
        frames = None
        base_frame = None
        ee_frame = None

        if robot:
            show_visual = True if show_visual is None else show_visual
            show_cm = True if show_cm is None else show_cm
            show_acm = True if show_acm is None else show_acm
            configuration = configuration or robot.zero_configuration()

            robot.update(configuration, visual=show_visual, collision=show_collision)
            compas_frames = robot.transformed_frames(configuration, group)

            if show_visual:
                visual = robot.artist.draw_visual()

            if show_collision:
                collision = robot.artist.draw_collision()

            if show_base_frame:
                base_compas_frame = compas_frames[0]
                artist = Artist(base_compas_frame)
                base_frame = artist.draw()

            if show_end_effector_frame:
                ee_compas_frame = robot.forward_kinematics(
                    configuration, group, options=dict(solver="model")
                )
                artist = Artist(ee_compas_frame)
                ee_frame = artist.draw()

            if show_frames:
                frames = []
                for compas_frame in compas_frames[1:]:
                    artist = Artist(compas_frame)
                    frame = artist.draw()
                    frames.append(frame)

            if show_cm or show_acm:
                scene = PlanningScene(robot)
                scene = robot.client.get_planning_scene()

                collision_meshes = []
                attached_meshes = []

                if show_cm:
                    for co in scene.world.collision_objects:
                        header = co.header
                        frame_id = header.frame_id
                        cms = co.to_collision_meshes()

                        for cm in cms:
                            if cm.frame != Frame.worldXY():
                                t = Transformation.from_frame(cm.frame)
                                mesh = cm.mesh.transformed(t)
                            else:
                                mesh = cm.mesh

                            collision_meshes.append(Artist(mesh).draw())

                if show_acm:
                    for aco in scene.robot_state.attached_collision_objects:
                        for acm in aco.to_attached_collision_meshes():
                            frame_id = aco.object["header"]["frame_id"]
                            frame = robot.forward_kinematics(
                                configuration, options=dict(link=frame_id)
                            )
                            t = Transformation.from_frame(frame)

                            # Local CM frame
                            if (
                                acm.collision_mesh.frame
                                and acm.collision_mesh.frame != Frame.worldXY()
                            ):
                                t = t * Transformation.from_frame(
                                    acm.collision_mesh.frame
                                )

                            mesh = acm.collision_mesh.mesh.transformed(t)

                            attached_meshes.append(Artist(mesh).draw())

        return (
            visual,
            collision,
            collision_meshes,
            attached_meshes,
            frames,
            base_frame,
            ee_frame,
        )
# ---------- end robot_visualize_2 ----------
scene = PlanningScene(robot=tool_2)  # -> scene
#   port scene: A planning scene.
# ---------- scene: Python ----------
"""
Create a planning scene.

COMPAS FAB v0.27.0
"""
from ghpythonlib.componentbase import executingcomponent as component
from scriptcontext import sticky as st

from compas_fab.ghpython.components import create_id
from compas_fab.robots import PlanningScene


class PlanningSceneComponent(component):
    def RunScript(self, robot):
        key = create_id(self, 'planning_scene')
        if robot:
            st[key] = PlanningScene(robot)
        return st.get(key, None)
# ---------- end scene ----------
cm = CollisionMesh(scene=scene, mesh=solid_union, identifier="table", add=Toggle(True), append=Toggle(False), remove=Button())  # -> ok; inputs mesh: Mesh, add: Boolean, append: Boolean, remove: Boolean
#   port scene: The planning scene.
#   port mesh: A collision mesh.
#   port identifier: The identifier of the collision mesh.
#   port add: If True, adds the collision mesh to the planning scene.
#   port append: If True, appends the collision mesh to the planning scene.
#   port remove: If True, removes the collision mesh from the planning scene.
#   port ok: True if the operation was successfully performed.
# ---------- cm: Python ----------
"""
Add or remove a collision mesh from the planning scene.

COMPAS FAB v0.27.0
"""
from compas_rhino.geometry import RhinoMesh
from ghpythonlib.componentbase import executingcomponent as component

from compas_fab.robots import CollisionMesh


class CollisionMeshComponent(component):
    def RunScript(self, scene, M, name, add, append, remove):
        ok = False
        self.Message = ""

        if (add and append) or (append and remove) or (add and remove):
            self.Message = "Use only one operation at a time\n(add, append or remove)"
            raise Exception(self.Message)

        if scene and M and name:
            mesh = RhinoMesh.from_geometry(M).to_compas()
            collision_mesh = CollisionMesh(mesh, name)
            if add:
                scene.add_collision_mesh(collision_mesh)
                self.Message = "Added"
                ok = True
            if append:
                scene.append_collision_mesh(collision_mesh)
                self.Message = "Appended"
                ok = True
            if remove:
                scene.remove_collision_mesh(name)
                self.Message = "Removed"
                ok = True
        return ok
# ---------- end cm ----------
move_2 = Move(Geometry=rotate_plane, Motion=vec.Vector)  # -> Geometry, Transform
python = GhPythonScript(robot=tool_2)  # -> out, a
# ---------- python: Python ----------
print robot.attached_tools
# ---------- end python ----------
inverse_kinematics_2 = InverseKinematics(robot=robot, plane=move_2.Geometry, start_configuration=merge_config, group="robotA")  # -> configuration
#   port plane: The plane or frame to calculate the inverse kinematic for.
#   port start_configuration: If passed, calculates the inverse such that the joint positions differ the least from the start_configuration. Defaults to the zero configuration.
#   port group: The planning group used for calculation. Defaults to the robot's main planning group.
#   port configuration: The planning group's configuration.
# ---------- inverse_kinematics_2: Python ----------
"""
Calculate the robot's inverse kinematic for a given plane.

COMPAS FAB v0.27.0
"""
from compas_rhino.conversions import RhinoPlane
from ghpythonlib.componentbase import executingcomponent as component


class InverseKinematics(component):
    def RunScript(self, robot, plane, start_configuration, group):
        configuration = None
        if robot and robot.client and robot.client.is_connected and plane:
            frame = RhinoPlane.from_geometry(plane).to_compas_frame()
            configuration = robot.inverse_kinematics(frame, start_configuration, group, False)
        return configuration
# ---------- end inverse_kinematics_2 ----------
# Collisions
panel_6 = Panel(python.out)
pickup_plane_robotb = Plane(pflip_2)
pickconfig_robota = Data(inverse_kinematics_2)
pickconfig_robotb = Data(inverse_kinematics)

# ----
# robotA PLACE Approach Config
toggle = BooleanToggle(False)
pflip_3 = FlipPlane(Plane=point_2, ReverseX=Toggle(True), ReverseY=toggle, SwapAxes=Toggle(False))
deplane = DeconstructPlane(Plane=pflip_3)  # -> Origin, XAxis, YAxis, ZAxis
amp = Amplitude(Vector=deplane.ZAxis, Amplitude=Slider(0.1, range=0..1))
move_3 = Move(Geometry=pflip_3, Motion=expr("-x", amp))  # -> Geometry, Transform
inverse_kinematics_3 = InverseKinematics(robot=robot, plane=move_3.Geometry, group="robotA")  # -> configuration; same code as inverse_kinematics

# ----
# robotB PLACE Approach Config
pflip_4 = FlipPlane(Plane=point_3, ReverseX=Toggle(False), ReverseY=Toggle(True), SwapAxes=Toggle(False))
deplane_2 = DeconstructPlane(Plane=pflip_4)  # -> Origin, XAxis, YAxis, ZAxis
amp_2 = Amplitude(Vector=deplane_2.ZAxis, Amplitude=expr("-x", Slider(0.07, range=0..0.1)))
move_4 = Move(Geometry=pflip_4, Motion=amp_2)  # -> Geometry, Transform
inverse_kinematics_4 = InverseKinematics(robot=robot, plane=move_4.Geometry, group="robotB")  # -> configuration; same code as inverse_kinematics
pln = Plane(move_4.Geometry)

approach_placing_plane_robota = Plane(move_3.Geometry)
approach_placing_plane_robob = Plane(pln)
placing_plane_robota = Plane(pflip_3)
placing_plane_robob = Plane(pflip_4)
placeconfig_robota = Data(inverse_kinematics_3)
placeconfig_robob = Data(inverse_kinematics_4)

# ---- group: 00_pickuptogether
merge_config_2 = MergeConfig(robot=robot, config_a=inverse_kinematics_3, config_b=placeconfig_robob, group_A="robotA", group_B="robotB")  # -> config; same code as merge_config

# ----
robot_visualize_3 = RobotVisualize(robot=ros_robot, configuration=merge_config_2)  # -> visual, collision, collision_meshes, attached_meshes, frames, base_frame, ee_frame; inputs show_visual: Boolean, show_collision: Boolean, show_frames: Boolean, show_base_frame: Boolean, show_end_effector_frame: Boolean, show_cm: Boolean, show_acm: Boolean; same code as robot_visualize_2

robot_2 = Data(robot)
element_7_robota_place_approach_config = Data(placeconfig_robota)
# Robot A - ELEMENT X
constraints_from_target_configuration = ConstraintsFromTargetConfiguration(robot=robot_2, target_configuration=element_7_robota_place_approach_config, group="robotA")  # -> flatten(constraints)
#   port target_configuration: The target configuration.
#   port tolerance_above: The tolerances above the targeted joint value of each configurable joint, defining the upper bound in radians/meters to be achieved.
#   port tolerance_below: The tolerances below the targeted joint value of each configurable joint, defining the lower bound in radians/meters to be achieved.
#   port group: The planning group for which we specify the constraint. Defaults to the robot's main planning group.
#   port constraints: A list joint constraints in radians/meters.
# ---------- constraints_from_target_configuration: Python ----------
"""
Create joint constraints for each of the robot's configurable joints based on a given target configuration.

COMPAS FAB v0.27.0
"""
import math

from ghpythonlib.componentbase import executingcomponent as component


class ConstraintsFromTargetConfiguration(component):

    DEFAULT_TOLERANCE_METERS = .001
    DEFAULT_TOLERANCE_RADIANS = math.radians(1)

    def RunScript(self, robot, target_configuration, tolerance_above, tolerance_below, group):
        if robot and target_configuration:
            tolerance_above = tolerance_above or self._generate_default_tolerances(robot.get_configurable_joints(group))
            tolerance_below = tolerance_below or self._generate_default_tolerances(robot.get_configurable_joints(group))

            constraints = robot.constraints_from_configuration(
                configuration=target_configuration,
                tolerances_above=tolerance_above,
                tolerances_below=tolerance_below,
                group=group
            )

            return constraints

    def _generate_default_tolerances(self, joints):
        return [
            self.DEFAULT_TOLERANCE_METERS if j.is_scalable()
            else self.DEFAULT_TOLERANCE_RADIANS
            for j in joints
        ]
# ---------- end constraints_from_target_configuration ----------
plan_motion = PlanMotion(
    robot=robot_2,
    goal_constraints=constraints_from_target_configuration,
    start_configuration=merge_config_2,
    group="robotA",
    compute=Toggle(True))  # -> trajectory; inputs goal_constraints: list, attached_collision_meshes: list, path_constraints: list, compute: Boolean
#   port goal_constraints: The goal to be achieved, defined in a set of constraints. Constraints can be very specific, for example defining value domains for each joint, such that the goal configuration is included, or defining a volume in space, to which a specific robot link (e.g. the end-effector) is required to move to.
#   port start_configuration: The robot's full configuration, i.e. values for all configurable joints of the entire robot, at the starting position. Defaults to the all-zero configuration.
#   port group: The planning group used for calculation. Defaults to the robot's main planning group.
#   port attached_collision_meshes: A list of attached collision meshes to be included for planning.
#   port path_constraints: Optional constraints that can be imposed along the solution path. Note that path calculation won't work if the start_configuration violates these constraints. Defaults to None.
#   port planner_id: The name of the algorithm used for path planning. Defaults to 'RRTConnect'
#   port compute: If True, calculates a trajectory.
#   port trajectory: The calculated trajectory.
# ---------- plan_motion: Python ----------
"""
Calculate a motion path.

COMPAS FAB v0.27.0
"""
from ghpythonlib.componentbase import executingcomponent as component
from scriptcontext import sticky as st

from compas_fab.ghpython.components import create_id


class PlanMotion(component):
    def RunScript(self, robot, goal_constraints, start_configuration, group, attached_collision_meshes, path_constraints, planner_id, compute):

        key = create_id(self, 'trajectory')

        path_constraints = list(path_constraints) if path_constraints else None
        attached_collision_meshes = list(attached_collision_meshes) if attached_collision_meshes else None
        planner_id = str(planner_id) if planner_id else 'RRTConnect'

        if robot and robot.client and robot.client.is_connected and start_configuration and goal_constraints and compute:
            st[key] = robot.plan_motion(goal_constraints,
                                        start_configuration=start_configuration,
                                        group=group,
                                        options=dict(
                                            attached_collision_meshes=attached_collision_meshes,
                                            path_constraints=path_constraints,
                                            planner_id=planner_id,
                                        ))
        trajectory = st.get(key, None)
        return trajectory
# ---------- end plan_motion ----------
trajectory_visualize = TrajectoryVisualize(robot=robot_2, group="robotA", trajectory=plan_motion)  # -> start_configuration, configurations, fraction, time, planes, P, V, A
#   port group: The planning group for which this trajectory was planned.
#   port trajectory: The calculated trajectory.
#   port start_configuration: The start configuration of the trajectory.
#   port configurations: The full configurations along the trajectory.
#   port fraction: Indicates the fraction of requested trajectory that was calculated, e.g. 1 means the full trajectory was found.
#   port time: The time which is needed to execute that trajectory at full speed.
#   port planes: The planes of the robot's end-effector.
#   port P: The positions along the trajectory
#   port V: The velocities along the trajectory
#   port A: The accelerations along the trajectory
# ---------- trajectory_visualize: Python ----------
"""
Visualizes a trajectory.

COMPAS FAB v0.27.0
"""
from compas_ghpython import draw_frame
from compas_ghpython import list_to_ghtree
from ghpythonlib.componentbase import executingcomponent as component


class TrajectoryVisualize(component):
    def RunScript(self, robot, group, trajectory):
        start_configuration = None
        configurations = []
        fraction = 0.
        time = 0.

        planes = []
        positions = []
        velocities = []
        accelerations = []

        if robot and trajectory:
            group = group or robot.main_group_name

            for c in trajectory.points:
                configurations.append(robot.merge_group_with_full_configuration(c, trajectory.start_configuration, group))
                frame = robot.forward_kinematics(c, group, options=dict(solver='model'))
                planes.append(draw_frame(frame))
                positions.append(c.positions)
                velocities.append(c.velocities)
                accelerations.append(c.accelerations)

            start_configuration = trajectory.start_configuration
            fraction = trajectory.fraction
            time = trajectory.time_from_start

        P = list_to_ghtree(list(zip(*positions)))
        V = list_to_ghtree(list(zip(*velocities)))
        A = list_to_ghtree(list(zip(*accelerations)))

        # return outputs if you have them; here I try it for you:
        return (start_configuration, configurations, fraction, time, planes, P, V, A)
# ---------- end trajectory_visualize ----------
robota_pick_approach_config = Data(pickconfig_robota)
robota_pickup_plane = Plane(pickup_plane__robota)

# ----
# Robot B - ELEMENT X
element_6_robotb_approach_place_config = Data(placeconfig_robob)
constraints_from_target_configuration_2 = ConstraintsFromTargetConfiguration(robot=robot, target_configuration=element_6_robotb_approach_place_config, group="robotB")  # -> flatten(constraints); same code as constraints_from_target_configuration
plan_motion_2 = PlanMotion(
    robot=robot,
    goal_constraints=constraints_from_target_configuration_2,
    start_configuration=merge_config_2,
    group="robotB",
    compute=Toggle(True))  # -> trajectory; inputs goal_constraints: list, attached_collision_meshes: list, path_constraints: list, compute: Boolean; same code as plan_motion
trajectory_visualize_2 = TrajectoryVisualize(robot=robot, group="robotB", trajectory=plan_motion_2)  # -> start_configuration, configurations, fraction, time, planes, P, V, A; same code as trajectory_visualize
transform = Transform(Geometry=pickup_plane_robotb, Transform=transformrobotatorobotb)
element_6_robot_b_place_plane = Plane(placing_plane_robob)
element_6_robotb_approach_place_config_2 = Data(placeconfig_robob)
robotb_pick_approach_config = Data(inverse_kinematics)
transform_2 = Transform(Geometry=approach_placing_plane_robob, Transform=transformrobotatorobotb)
transform_3 = Transform(Geometry=element_6_robot_b_place_plane, Transform=transformrobotatorobotb)
robotb_pickup = Plane(transform)

# ----
# Export to Json
export = Button()
# Export to Json
# Export to Json
send = GhPythonScript(
    robot=ros_robot,
    approach_pickup_config=robotb_pick_approach_config,
    pickup_plane=robotb_pickup,
    approach_place_plane=transform_2,
    approach_place_config=element_6_robotb_approach_place_config_2,
    place_plane=transform_3,
    configurations_pick_to_place=trajectory_visualize_2.configurations,
    export=export,
    speed=Slider(200, range=0..1000),
    file_name="ogee_b_58")  # -> actions; inputs pickup_plane: Plane, approach_place_plane: Plane, configurations_pick_to_place: list
# ---------- send: Python ----------
from datetime import datetime as dt
import os
import compas
import sys
from compas_rhino import unload_modules
from compas_rhino.conversions import RhinoPlane, RhinoMesh
from compas.geometry import Scale, Frame
from compas_fab.robots import Robot
from compas_ghpython.utilities import ghtree_to_list
import compas_rrc as rrc
import time
from compas_rhino.conversions import plane_to_compas_frame
import Rhino.Geometry as rg
import math

HERE = ghenv.LocalScope.ghdoc.Path
DATA = os.path.abspath(os.path.join(HERE, '..', '..', 'data'))
now = dt.now().strftime("%Y%m%d_")
file_path = DATA + "/" + now + file_name + ".json"

path = DATA = os.path.abspath(os.path.join(HERE, '..', '..', 'python'))
if path not in sys.path:
    sys.path.append(path)

scalefactor = 1000
S = Scale.from_factors([scalefactor] * 3)

unload_modules('production_data')
from production_data import Action, ProductionData

actions = []

scalefactor = 1000
S = Scale.from_factors([scalefactor] * 3)

# Set tool
actions.append(Action('SetTool', dict(tool_name='tool0'), action_id = 0))
# Set work object
actions.append(Action('SetWorkObject', dict(wobj_name='wobj0'), action_id = 1))
id = 1

id +=1
actions.append(Action('PrintText', dict(text='Pickup Element?'), action_id = id))
id +=1
actions.append(Action('Stop', dict(), action_id = id))

#open gripper
id +=1
actions.append(Action('SetDigital', dict(io_name = 'ABB_Scalable_IO_0_DO16', value = 0),action_id = id))

#send above pickup with configuration
joints = [math.degrees(j) for j in approach_pickup_config.joint_values]
id +=1
actions.append(Action('MoveToJoints', dict(joints = joints, ext_axes = [], speed=speed, zone= rrc.Zone.FINE, feedback_level=rrc.FeedbackLevel.DONE), action_id = id))

#send to pickup with plane
frame = plane_to_compas_frame(pickup_plane)
frame_rob = robot.from_tcf_to_t0cf([frame])[0]
scaled_frame = frame_rob.transformed(S)
id +=1
actions.append(Action('MoveToFrame', dict(frame= scaled_frame, speed=speed, zone=rrc.Zone.FINE, motion_type='rrc.Motion.LINEAR',feedback_level=rrc.FeedbackLevel.DONE), action_id = id))

#wait

id +=1
actions.append(Action('WaitTime', dict(time = 0.5,  feedback_level=rrc.FeedbackLevel.DONE), action_id = id))

#close
id +=1
actions.append(Action('SetDigital', dict(io_name = 'ABB_Scalable_IO_0_DO16', value = 1),action_id = id))

#config
#send above pickup with configuration
joints = [math.degrees(j) for j in approach_pickup_config.joint_values]
id +=1
actions.append(Action('MoveToJoints', dict(joints = joints, ext_axes = [], speed=speed, zone= rrc.Zone.FINE, feedback_level=rrc.FeedbackLevel.DONE), action_id = id))

#trajectory from above pickup to normal to place
for configuration in configurations_pick_to_place:
    
    temp = []
    for n,j in zip(configuration.joint_names,configuration.joint_values):
        if n == "robotB_joint_1":
            temp.append(j)
    for n,j in zip(configuration.joint_names,configuration.joint_values):
        if n == "robotB_joint_2":
            temp.append(j)
    for n,j in zip(configuration.joint_names,configuration.joint_values):
        if n == "robotB_joint_3":
            temp.append(j)
    for n,j in zip(configuration.joint_names,configuration.joint_values):
        if n == "robotB_joint_4":
            temp.append(j)
    for n,j in zip(configuration.joint_names,configuration.joint_values):
        if n == "robotB_joint_5":
            temp.append(j)
    for n,j in zip(configuration.joint_names,configuration.joint_values):
        if n == "robotB_joint_6":
            temp.append(j)

    joints = [math.degrees(j) for j in temp]
    #print joints
    id +=1
    actions.append(Action('MoveToJoints', dict(joints = joints, ext_axes = [], speed=speed, zone= 5, feedback_level=rrc.FeedbackLevel.DONE), action_id = id))

#text
id +=1
actions.append(Action('PrintText', dict(text='RobotB goes to final position of element'), action_id = id))
id +=1
actions.append(Action('Stop', dict(), action_id = id))

#place with plane
frame = plane_to_compas_frame(place_plane)
frame_rob = robot.from_tcf_to_t0cf([frame])[0]
scaled_frame = frame_rob.transformed(S)
id +=1
actions.append(Action('MoveToFrame', dict(frame= scaled_frame, speed=speed, zone=rrc.Zone.FINE, motion_type='rrc.Motion.LINEAR',feedback_level=rrc.FeedbackLevel.DONE), action_id = id))

#can I leave?
id +=1
actions.append(Action('PrintText', dict(text='Release element?'), action_id = id))
id +=1
actions.append(Action('Stop', dict(), action_id = id))

#open gripper
id +=1
actions.append(Action('SetDigital', dict(io_name = 'ABB_Scalable_IO_0_DO16', value = 0),action_id = id))

#wait
id +=1
actions.append(Action('WaitTime', dict(time = 0.5,  feedback_level=rrc.FeedbackLevel.DONE), action_id = id))

#send to approach place plane
frame = plane_to_compas_frame(approach_place_plane)
frame_rob = robot.from_tcf_to_t0cf([frame])[0]
scaled_frame = frame_rob.transformed(S)
id +=1
actions.append(Action('MoveToFrame', dict(frame= scaled_frame, speed=speed, zone=rrc.Zone.FINE, motion_type='rrc.Motion.LINEAR',feedback_level=rrc.FeedbackLevel.DONE), action_id = id))

#send above pickup with configuration
id +=1
actions.append(Action('PrintText', dict(text='RobotB goes to pick element'), action_id = id))
id +=1
actions.append(Action('Stop', dict(), action_id = id))

#REVERSE?
for configuration in configurations_pick_to_place[::-1]:
    
    temp = []
    for n,j in zip(configuration.joint_names,configuration.joint_values):
        if n == "robotB_joint_1":
            temp.append(j)
    for n,j in zip(configuration.joint_names,configuration.joint_values):
        if n == "robotB_joint_2":
            temp.append(j)
    for n,j in zip(configuration.joint_names,configuration.joint_values):
        if n == "robotB_joint_3":
            temp.append(j)
    for n,j in zip(configuration.joint_names,configuration.joint_values):
        if n == "robotB_joint_4":
            temp.append(j)
    for n,j in zip(configuration.joint_names,configuration.joint_values):
        if n == "robotB_joint_5":
            temp.append(j)
    for n,j in zip(configuration.joint_names,configuration.joint_values):
        if n == "robotB_joint_6":
            temp.append(j)

    joints = [math.degrees(j) for j in temp]
    #print joints
    id +=1
    actions.append(Action('MoveToJoints', dict(joints = joints, ext_axes = [], speed=speed, zone= 5, feedback_level=rrc.FeedbackLevel.DONE), action_id = id))


production_data = ProductionData(actions)

if export:
    with open(file_path, 'w') as fp:
        compas.json_dump(production_data.to_data(), fp)
# ---------- end send ----------

approach_placing_plane_robota_2 = Plane(approach_placing_plane_robota)
robota_approach_place_config = Data(placeconfig_robota)
robota_place_plane = Plane(placing_plane_robota)

# ----
# Export to Json
panel_7 = Panel("ogee_a_53")
export_2 = Button()
send_2 = GhPythonScript(
    robot=ros_robot,
    approach_pickup_config=robota_pick_approach_config,
    approach_place_plane=approach_placing_plane_robota_2,
    pickup_plane=robota_pickup_plane,
    approach_place_config=robota_approach_place_config,
    place_plane=robota_place_plane,
    configurations_pick_to_place=trajectory_visualize.configurations,
    export=export_2,
    speed=Slider(200, range=0..1000),
    file_name=panel_7)  # -> actions; inputs approach_place_plane: Plane, pickup_plane: Plane, configurations_pick_to_place: list
# ---------- send_2: Python ----------
from datetime import datetime as dt
import os
import compas
import sys
from compas_rhino import unload_modules
from compas_rhino.conversions import RhinoPlane, RhinoMesh
from compas.geometry import Scale, Frame
from compas_fab.robots import Robot
from compas_ghpython.utilities import ghtree_to_list
import compas_rrc as rrc
import time
from compas_rhino.conversions import plane_to_compas_frame
import Rhino.Geometry as rg
import math

HERE = ghenv.LocalScope.ghdoc.Path
DATA = os.path.abspath(os.path.join(HERE, '..', '..', 'data'))
now = dt.now().strftime("%Y%m%d_")
file_path = DATA + "/" + now + file_name + ".json"

path = DATA = os.path.abspath(os.path.join(HERE, '..', '..', 'python'))
if path not in sys.path:
    sys.path.append(path)

scalefactor = 1000
S = Scale.from_factors([scalefactor] * 3)

unload_modules('production_data')
from production_data import Action, ProductionData

actions = []

scalefactor = 1000
S = Scale.from_factors([scalefactor] * 3)

# Set tool
actions.append(Action('SetTool', dict(tool_name='tool0'), action_id = 0))
# Set work object
actions.append(Action('SetWorkObject', dict(wobj_name='wobj0'), action_id = 1))
id = 1

id +=1
actions.append(Action('PrintText', dict(text='Pickup Element?'), action_id = id))
id +=1
actions.append(Action('Stop', dict(), action_id = id))

#open gripper
id +=1
actions.append(Action('SetDigital', dict(io_name = 'ABB_Scalable_IO_0_DO16', value = 0),action_id = id))

#send above pickup with configuration
joints = [math.degrees(j) for j in approach_pickup_config.joint_values]
id +=1
actions.append(Action('MoveToJoints', dict(joints = joints, ext_axes = [], speed=speed, zone= rrc.Zone.FINE, feedback_level=rrc.FeedbackLevel.DONE), action_id = id))

#send to pickup with plane
frame = plane_to_compas_frame(pickup_plane)
frame_rob = robot.from_tcf_to_t0cf([frame])[0]
scaled_frame = frame_rob.transformed(S)
id +=1
actions.append(Action('MoveToFrame', dict(frame= scaled_frame, speed=speed, zone=rrc.Zone.FINE, motion_type='rrc.Motion.LINEAR',feedback_level=rrc.FeedbackLevel.DONE), action_id = id))

#wait

id +=1
actions.append(Action('WaitTime', dict(time = 0.5,  feedback_level=rrc.FeedbackLevel.DONE), action_id = id))

#close
id +=1
actions.append(Action('SetDigital', dict(io_name = 'ABB_Scalable_IO_0_DO16', value = 1),action_id = id))

#config
#send above pickup with configuration
joints = [math.degrees(j) for j in approach_pickup_config.joint_values]
id +=1
actions.append(Action('MoveToJoints', dict(joints = joints, ext_axes = [], speed=speed, zone= rrc.Zone.FINE, feedback_level=rrc.FeedbackLevel.DONE), action_id = id))

#trajectory from above pickup to normal to place
for configuration in configurations_pick_to_place:
    
    temp = []
    for n,j in zip(configuration.joint_names,configuration.joint_values):
        if n == "robotA_joint_1":
            temp.append(j)
    for n,j in zip(configuration.joint_names,configuration.joint_values):
        if n == "robotA_joint_2":
            temp.append(j)
    for n,j in zip(configuration.joint_names,configuration.joint_values):
        if n == "robotA_joint_3":
            temp.append(j)
    for n,j in zip(configuration.joint_names,configuration.joint_values):
        if n == "robotA_joint_4":
            temp.append(j)
    for n,j in zip(configuration.joint_names,configuration.joint_values):
        if n == "robotA_joint_5":
            temp.append(j)
    for n,j in zip(configuration.joint_names,configuration.joint_values):
        if n == "robotA_joint_6":
            temp.append(j)

    joints = [math.degrees(j) for j in temp]
    print joints
    id +=1
    actions.append(Action('MoveToJoints', dict(joints = joints, ext_axes = [], speed=speed, zone= 5, feedback_level=rrc.FeedbackLevel.DONE), action_id = id))

#text
id +=1
actions.append(Action('PrintText', dict(text='RobotA goes to final position of element'), action_id = id))
id +=1
actions.append(Action('Stop', dict(), action_id = id))

#place with plane
frame = plane_to_compas_frame(place_plane)
frame_rob = robot.from_tcf_to_t0cf([frame])[0]
scaled_frame = frame_rob.transformed(S)
id +=1
actions.append(Action('MoveToFrame', dict(frame= scaled_frame, speed=speed, zone=rrc.Zone.FINE, motion_type='rrc.Motion.LINEAR',feedback_level=rrc.FeedbackLevel.DONE), action_id = id))

#can I leave?
id +=1
actions.append(Action('PrintText', dict(text='Release element?'), action_id = id))
id +=1
actions.append(Action('Stop', dict(), action_id = id))

#open gripper
id +=1
actions.append(Action('SetDigital', dict(io_name = 'ABB_Scalable_IO_0_DO16', value = 0),action_id = id))

#wait
id +=1
actions.append(Action('WaitTime', dict(time = 0.5,  feedback_level=rrc.FeedbackLevel.DONE), action_id = id))

#send to approach place plane
frame = plane_to_compas_frame(approach_place_plane)
frame_rob = robot.from_tcf_to_t0cf([frame])[0]
scaled_frame = frame_rob.transformed(S)
id +=1
actions.append(Action('MoveToFrame', dict(frame= scaled_frame, speed=speed, zone=rrc.Zone.FINE, motion_type='rrc.Motion.LINEAR',feedback_level=rrc.FeedbackLevel.DONE), action_id = id))

#send above pickup with configuration
id +=1
actions.append(Action('PrintText', dict(text='RobotA goes to pick element'), action_id = id))
id +=1
actions.append(Action('Stop', dict(), action_id = id))

#REVERSE?
for configuration in configurations_pick_to_place[::-1]:
    
    temp = []
    for n,j in zip(configuration.joint_names,configuration.joint_values):
        if n == "robotA_joint_1":
            temp.append(j)
    for n,j in zip(configuration.joint_names,configuration.joint_values):
        if n == "robotA_joint_2":
            temp.append(j)
    for n,j in zip(configuration.joint_names,configuration.joint_values):
        if n == "robotA_joint_3":
            temp.append(j)
    for n,j in zip(configuration.joint_names,configuration.joint_values):
        if n == "robotA_joint_4":
            temp.append(j)
    for n,j in zip(configuration.joint_names,configuration.joint_values):
        if n == "robotA_joint_5":
            temp.append(j)
    for n,j in zip(configuration.joint_names,configuration.joint_values):
        if n == "robotA_joint_6":
            temp.append(j)

    joints = [math.degrees(j) for j in temp]
    #print joints
    id +=1
    actions.append(Action('MoveToJoints', dict(joints = joints, ext_axes = [], speed=speed, zone= 5, feedback_level=rrc.FeedbackLevel.DONE), action_id = id))


production_data = ProductionData(actions)

if export:
    with open(file_path, 'w') as fp:
        compas.json_dump(production_data.to_data(), fp)
# ---------- end send_2 ----------

# ---- group: A9
data = Data(send_2)
