# Grasshopper definition geo.ghx (Grasshopper 1.0.8)
# plug-ins: RhinoCodePluginGH

panel = Panel("""0.2
0.1""")
panel_2 = Panel("""0.4
0.2""")
point = Point([Point(-0.8391112276, 6.453867549, 0), Point(-13.90110394, 4.895028912, 0), Point(-7.343231058, 1.078561904, 0), Point(6.256292223, 5.325053364, 0), Point(1.095998804, 3.766214727, 0), Point(5.127478038, 1.078561904, 0), Point(9.911500062, 2.95991888, 0), Point(-7.242696716, 5.46049494, 0)])
curve = Curve([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])
line = Line(curve)
list_length = ListLength(List=line)
point_on_curve = PointOnCurve(line, parameter=0.5)
repeat_data = RepeatData(Data=panel_2, Length=list_length)
repeat_data_2 = RepeatData(Data=panel, Length=list_length)
point_list = PointList(Points=point, Size=Slider(2, range=0..10))
point_list_2 = PointList(Points=point_on_curve, Size=Slider(1, range=0..1))
python_3_script = Python3Script(points=point, lines=line, widths=repeat_data, heights=repeat_data_2)  # -> out, a, points, cut_rectangles, rectangles; inputs points: list of Point3d, lines: list of Line, widths: list of Double, heights: list of Double
# ---------- python_3_script: Python ----------
import Rhino.Geometry as rg
import math

class Beam:
    def __init__(self, axis, height, width):

        self.axis = axis
        self.height = height
        self.width = width
        self.uncut_polyline = self.get_uncut_polyline()
        self.cut_polyline = self.uncut_polyline

    def get_uncut_polyline(self):

        line_direction = self.axis.Direction
        line_direction.Unitize()

        # Create a perpendicular vector for width
        perp = rg.Vector3d.CrossProduct(line_direction, rg.Vector3d.ZAxis)
        perp.Unitize()
        perp *= (0.5 * self.width)

        # Define the corners of the rectangular profile
        corners = [
            self.axis.From + perp,
            self.axis.From - perp,
            self.axis.To - perp,
            self.axis.To + perp
        ]

        # Create the rectangle polyline
        rectangle = rg.Polyline(corners + [corners[0]])
        return rg.PolylineCurve(rectangle)


class Node:
    def __init__(self, position, beams):

        self.position = position
        self.connected_beams = []
        self.filter_beams(beams)

    def add_beam(self, beam):

        self.connected_beams.append(beam)

    def filter_beams(self, all_beams, tolerance=1e-6):

        for beam in all_beams:
            # Check if either endpoint of the beam's axis is close to the node's position
            if beam.axis.From.DistanceTo(self.position) < tolerance or beam.axis.To.DistanceTo(self.position) < tolerance:
                self.add_beam(beam)
    
    def organize_beams(self):

        angles = []
        for beam in self.connected_beams:
            if beam.axis.From.DistanceTo(self.position) < 1e-6:
                direction = beam.axis.To - self.position
            else:
                direction = beam.axis.From - self.position
            
            # Calculate angle using atan2
            angles.append(math.atan2(direction.Y, direction.X))

        # Sort connected beams by angle
        self.connected_beams = [x for _, x in sorted(zip(angles, self.connected_beams))]

    def cut_beams(self):
        

        for i, beam1 in enumerate(self.connected_beams):
            beam2 = self.connected_beams[(i+1)%len(self.connected_beams)]
            events = rg.Intersect.Intersection.CurveCurve(
                beam1.cut_polyline, beam2.cut_polyline, 1e-6, 1e-6
            )
            
            if events.Count>=2:
                intersection_points = [event.PointA for event in events]
                print (len(intersection_points))
                furthest_point = max(intersection_points, key=lambda pt: pt.DistanceTo(self.position))

                # Create a line from the node position to the furthest intersection point
                cutting_line = rg.Line(self.position, furthest_point)
                cutting_line.Extend(0.2,0.2)
                #cut beam1
                beam1.cut_polyline.Domain = rg.Interval(0,1)
                par = [beam1.cut_polyline.ClosestPoint(self.position)[1], beam1.cut_polyline.ClosestPoint(furthest_point)[1] ]
                split = beam1.cut_polyline.Split(par)

                if split[0].GetLength() > split[1].GetLength():
                    beam1.cut_polyline = split[0]
                else:
                    beam1.cut_polyline = split[1]

                #close curve
                pol = beam1.cut_polyline.TryGetPolyline()[1]
                new_points = [p for p in pol]
                new_points.append(new_points[0])
                beam1.cut_polyline = rg.Curve.CreateInterpolatedCurve(new_points, 1)

                #cut beam2
                beam2.cut_polyline.Domain = rg.Interval(0,1)
                par = [beam2.cut_polyline.ClosestPoint(self.position)[1], beam2.cut_polyline.ClosestPoint(furthest_point)[1] ]
                split = beam2.cut_polyline.Split(par)

                if split[0].GetLength() > split[1].GetLength():
                    beam2.cut_polyline = split[0]
                else:
                    beam2.cut_polyline = split[1]

                #close curve
                pol = beam2.cut_polyline.TryGetPolyline()[1]
                new_points = [p for p in pol]
                new_points.append(new_points[0])
                beam2.cut_polyline = rg.Curve.CreateInterpolatedCurve(new_points, 1)

                


rectangles = []
beams = [Beam(lines[i],heights[i], widths[i]) for i in range(len(lines))]
rectangles = [b.uncut_polyline for b in beams]
nodes = [Node(points[j],beams) for j in range(len(points))]

a=[]
for idx,n in enumerate(nodes):
    print("the node idx is {}".format(idx))
    n.organize_beams()
    n.cut_beams()

cut_rectangles = [b.cut_polyline for b in beams]
# ---------- end python_3_script ----------

# ---- group: CSV export
python_3_script_2 = Python3Script(points=point, lines=line, file_name="example", go=Toggle(True))  # -> out, a; inputs points: list of Point3d, lines: list of Line, go: Boolean
# ---------- python_3_script_2: Python ----------
import Rhino.Geometry as rg
import Grasshopper
import os
import csv

HERE = ghenv.Component.OnPingDocument().FilePath


CSV = os.path.abspath(os.path.join(HERE, '..', '..', 'CSV'))

file_path = CSV + "/"+ file_name + ".csv"

# Function to export points and lines to a CSV
def export_to_csv(points, lines, file_path):
    # Prepare data for CSV
    point_list = [(i, p.X, p.Y, p.Z) for i, p in enumerate(points)]  # (index, x, y, z)
    line_list = [(i, points.index(l.From), points.index(l.To)) for i, l in enumerate(lines)]  # (line_index, start, end)
    
    # Write data to CSV
    with open(file_path, 'w', newline='') as file:
        writer = csv.writer(file)
        
        # Write points
        writer.writerow(['Point_Index', 'X', 'Y', 'Z'])
        for point in point_list:
            writer.writerow(point)
        
        # Write a blank line for separation
        writer.writerow([])
        
        # Write lines
        writer.writerow(['Line_Index', 'Start_Point_Index', 'End_Point_Index'])
        for line in line_list:
            writer.writerow(line)
    
    return f"Exported CSV to {file_path}"

# Inputs: `points` (list of Point3d), `lines` (list of Line)
if go:
    result = export_to_csv(points, lines, file_path)
# ---------- end python_3_script_2 ----------

# ----
point_2 = Point(python_3_script.points)
geometry = Geometry(python_3_script.cut_rectangles)
curve_2 = Curve(python_3_script.rectangles)
panel_3 = Panel(python_3_script_2.out)
list_item = ListItem(List=[geometry, curve_2], Index=0, Wrap=True)
