# Grasshopper definition ros_example.gh (Grasshopper 1.0.8)
# plug-ins: RhinoCodePluginGH

# ---- group: Connect to ROS host
ros_connect = Python3Script(ip="localhost", port="9090", connect=Toggle(True))  # -> out, ros_client, is_connected; inputs port: Int32
# ---------- ros_connect: Python ----------
#r: compas_fab
import time

from ghpythonlib.componentbase import executingcomponent as component
from scriptcontext import sticky as st

from compas_fab.backends import RosClient
from compas_fab.ghpython.components import create_id


class ROSConnect(component):
    def RunScript(self, ip, port: int, connect):
        ros_client = None

        if not ip:
            ip = "localhost"
        if not port:
            port = 9090

        print("Try connecting to: ", ip, ":", port)

        key = create_id(ghenv.Component, "ros_client")
        ros_client = st.get(key, None)

        if ros_client:
            print("Close previous connection:", key)
            st[key].close()

        if connect:
            print("Build new connection:", key)
            st[key] = RosClient(ip, port)
            st[key].run(5)

        ros_client = st.get(key, None)
        is_connected = ros_client.is_connected if ros_client else False
        return (ros_client, is_connected)
# ---------- end ros_connect ----------

# ---- group: Subscriber
ros_subscribe = Python3Script(
    ros_client=ros_connect.ros_client,
    topic_name="/camera/image/compressed",
    topic_type="sensor_msgs/CompressedImage",
    start=Button(),
    stop=Button())  # -> topic, last_msg, is_subscribed
# ---------- ros_subscribe: Python ----------
"""
Subscribe to a ROS topic.

COMPAS FAB v1.0.2
"""

#r: compas_fab

import time

import Grasshopper.Kernel
from ghpythonlib.componentbase import executingcomponent as component
from roslibpy import Topic
from scriptcontext import sticky as st

from compas_fab.backends.ros.messages import ROSmsg
from compas_fab.ghpython.components import create_id


class ROSTopicSubscribe(component):
    def RunScript(self, ros_client, topic_name, topic_type, interval, start, stop):
        if not topic_name:
            raise ValueError("Please specify the name of the topic")
        if not topic_type:
            raise ValueError("Please specify the type of the topic")

        if not hasattr(self, "message_count"):
            self.message_count = 0

        self.interval = interval or 25  # in milliseconds
        self.is_updating = False
        self.is_subscribed = False

        self.msg_key = create_id(ghenv.Component, "last_msg")
        key = create_id(ghenv.Component, "topic")

        last_msg = st.get(self.msg_key, None)
        topic = st.get(key, None)

        if ros_client and ros_client.is_connected:
            if start:
                self._unsubscribe(topic)

                topic = Topic(ros_client, topic_name, topic_type)
                topic.subscribe(self.topic_callback)
                time.sleep(0.2)

                st[key] = topic

            if stop:
                self._unsubscribe(topic)

        self.is_subscribed = topic and topic.is_subscribed

        if last_msg:
            last_msg = [ROSmsg.parse(last_msg, topic_type)]

        if self.is_subscribed:
            self.Message = "Subscribed, {} messages".format(self.message_count)
        else:
            self.Message = "Not subscribed"

        return (topic, last_msg, self.is_subscribed)

    def _unsubscribe(self, topic):
        if topic and topic.is_subscribed:
            topic.unsubscribe()
            time.sleep(0.2)

    def topic_callback(self, msg):
        self.message_count += 1
        st[self.msg_key] = msg

        if self.is_subscribed:
            ghdoc = ghenv.Component.OnPingDocument()  # noqa: F821 This is defined by Grasshopper
            if not self.is_updating and ghdoc.SolutionState != Grasshopper.Kernel.GH_ProcessStep.Process:
                self.is_updating = True
                ghdoc.ScheduleSolution(
                    self.interval, Grasshopper.Kernel.GH_Document.GH_ScheduleDelegate(self.expire_callback)
                )
                
    def expire_callback(self, ghdoc):
        if ghdoc.SolutionState != Grasshopper.Kernel.GH_ProcessStep.Process:
            ghenv.Component.ExpireSolution(False)  # noqa: F821 This is defined by Grasshopper
        self.is_updating = False
# ---------- end ros_subscribe ----------

# ----
ros_subscribe_2 = Python3Script(ros_client=ros_connect.ros_client, topic_name="/chatter", topic_type="std_msgs/String", start=Button(), stop=Button())  # -> topic, last_msg, is_subscribed
# ---------- ros_subscribe_2: Python ----------
"""
Subscribe to a ROS topic.

COMPAS FAB v1.0.2
"""

#r: compas_fab

import time

import Grasshopper.Kernel
from ghpythonlib.componentbase import executingcomponent as component
from roslibpy import Topic
from scriptcontext import sticky as st

from compas_fab.backends.ros.messages import ROSmsg
from compas_fab.ghpython.components import create_id


class ROSTopicSubscribe(component):
    def RunScript(self, ros_client, topic_name, topic_type, interval, start, stop):
        if not topic_name:
            raise ValueError("Please specify the name of the topic")
        if not topic_type:
            raise ValueError("Please specify the type of the topic")

        if not hasattr(self, "message_count"):
            self.message_count = 0

        self.interval = interval or 25  # in milliseconds
        self.is_updating = False
        self.is_subscribed = False

        self.msg_key = create_id(ghenv.Component, "last_msg")
        key = create_id(ghenv.Component, "topic")

        last_msg = st.get(self.msg_key, None)
        topic = st.get(key, None)

        if ros_client and ros_client.is_connected:
            if start:
                self._unsubscribe(topic)

                topic = Topic(ros_client, topic_name, topic_type)
                topic.subscribe(self.topic_callback)
                time.sleep(0.2)

                st[key] = topic

            if stop:
                self._unsubscribe(topic)

        self.is_subscribed = topic and topic.is_subscribed

        if last_msg:
            last_msg = ROSmsg.parse(last_msg, topic_type)

        if self.is_subscribed:
            self.Message = "Subscribed, {} messages".format(self.message_count)
        else:
            self.Message = "Not subscribed"

        return (topic, last_msg, self.is_subscribed)

    def _unsubscribe(self, topic):
        if topic and topic.is_subscribed:
            topic.unsubscribe()
            time.sleep(0.2)

    def topic_callback(self, msg):
        self.message_count += 1
        st[self.msg_key] = msg

        if self.is_subscribed:
            ghdoc = ghenv.Component.OnPingDocument()  # noqa: F821 This is defined by Grasshopper
            if not self.is_updating and ghdoc.SolutionState != Grasshopper.Kernel.GH_ProcessStep.Process:
                self.is_updating = True
                ghdoc.ScheduleSolution(
                    self.interval, Grasshopper.Kernel.GH_Document.GH_ScheduleDelegate(self.expire_callback)
                )
                
    def expire_callback(self, ghdoc):
        if ghdoc.SolutionState != Grasshopper.Kernel.GH_ProcessStep.Process:
            ghenv.Component.ExpireSolution(False)  # noqa: F821 This is defined by Grasshopper
        self.is_updating = False
# ---------- end ros_subscribe_2 ----------

panel = Panel(ros_subscribe_2.last_msg)

# ---- group: If the msg is actually a file, this can be used to save it to the assigned location
panel_2 = Panel("/Users/petingo/Documents/CRCL/ROS_test/video_stream/test_gh_output.jpg")
file_saver = Python3Script(msg=ros_subscribe.last_msg, filepath=panel_2)  # -> id, filepath
# ---------- file_saver: Python ----------
import base64

data_bytes_base64 = msg.data.encode('ascii')
data_bytes = base64.b64decode(data_bytes_base64)
with open(filepath, 'wb') as f:
    f.write(data_bytes)
# ---------- end file_saver ----------
